# Grasshopper definition RhinoExporter.gh (Grasshopper 1.0.7)

panel = Panel("D:\Unity\School\ALIS_WFC\WaveFunctionCollapseUnity\RhinoExporter\")
panel_2 = Panel("""2
7""")
panel_3 = Panel("""Standard
Facade
Column
Beam
Bathroom
Circulation
Empty""")
panel_4 = Panel("""2
7""")
panel_5 = Panel("""3
4""")
number_slider = Slider(2, range=0..10)
panel_6 = Panel("""2
7""")
panel_7 = Panel("""2
7""")
panel_8 = Panel("""4
6""")
c_script = CSharpScript(
    Export=Button(),
    Path=panel,
    BlockNames="block",
    InstanceLayer="Instances",
    id=Slider(8, range=0..100),
    density=Slider(1, range=0..5),
    type=number_slider,
    minX=panel_2,
    plusX=panel_7,
    minY=panel_4,
    plusY=panel_6,
    minZ=panel_5,
    plusZ=panel_8)  # -> out; inputs Export: Boolean, Path: String, BlockNames: list of String, InstanceLayer: String, id: Int32, density: Int32, type: Int32, minX: list of Int32, plusX: list of Int32, minY: list of Int32, plusY: list of Int32, minZ: list of Int32, plusZ: list of Int32
# ---------- c_script: C# usings ----------
  using System.Linq;
  using System.Xml;
  using System.Xml.Serialization;
  using Rhino.DocObjects;
# ---------- c_script: C# ----------
    String filename = Path + "Sample_" + id + ".xml";
    
    if(Export)
    Assembly.Export(BlockNames, InstanceLayer, filename, Rhino.RhinoDoc.ActiveDoc, minX, plusX, minY, plusY, minZ, plusZ, id, density, type);

    //assembly.Export(BlockNames,IntanceLayer,1,1,1,Filename,
# ---------- c_script: C# additional code ----------
  //Reduced version of the Extensions Unity Exporter script by Vicente
  public class Assembly
  {
    public List<Instance> Instances { get; set; }
    public List<Neighbour> Neighbours { get; set;}
    public int Id;
    public int Density;
    public int Type;
    private Assembly() { }

    public static void Export(List<string> blockNames, string instanceLayerName, string fileName, RhinoDoc doc, List<int>minX, List<int>plusX, List<int>minY, List<int>plusY, List<int>minZ, List<int>plusZ, int id, int density, int type)
    {
      var definitions = blockNames.Select(n => doc.InstanceDefinitions.First(i => i.Name == n));
      var instanceLayer = doc.Layers.FindName(instanceLayerName);

      var assembly = new Assembly()
        {

          Instances = definitions
          .SelectMany(d => d.GetReferences(1).Where(i => i.Attributes.LayerIndex == instanceLayer.Index))
          .Select(d => new Instance(d.InstanceDefinition.Index, d.InstanceXform))
          .ToList()
          };

      assembly.Neighbours = new List<Neighbour>(){
          new Neighbour(minX),
          new Neighbour(plusX),
          new Neighbour(minZ),
          new Neighbour(plusZ),
          new Neighbour(minY),
          new Neighbour(plusY)};
      assembly.Id = id;
      assembly.Density = density;
      assembly.Type = type;

      var serializer = new XmlSerializer(typeof(Assembly));
      using (var writer = XmlWriter.Create(fileName))
      {
        serializer.Serialize(writer, assembly);
      }
    }
  }

  public class Neighbour
  {
    public List<int> Neighbours;

    private Neighbour(){}
    public Neighbour(List<int> neighbours)
    {
      Neighbours = neighbours;
    }
  }

  public class Instance
  {
    public int DefinitionIndex;
    public Pose Pose;


    private Instance() { }

    public Instance(int definitionIndex, Transform transform)
    {
      DefinitionIndex = definitionIndex;

      var plane = Plane.WorldXY;
      plane.Transform(transform);
      Pose = new Pose(plane);
    }
  }

  [XmlType(TypeName = "Vector3")]
  public struct Vector3Export
  {
    public float x, y, z;

    public Vector3Export(Point3d point)
    {
      x = (float) point.X;
      y = (float) point.Z;
      z = (float) point.Y;
    }

    public Vector3Export(Point3f point)
    {
      x = point.X;
      y = point.Z;
      z = point.Y;
    }
  }

  [XmlType(TypeName = "Vector2")]
  public struct Vector2Export
  {
    public float x, y;

    public Vector2Export(Point2f point)
    {
      x = point.X;
      y = point.Y;
    }
  }

  public struct Pose
  {
    public Vector3Export position;
    public QuaternionExport rotation;

    public Pose(Plane plane)
    {
      position = new Vector3Export(plane.Origin);
      rotation = new QuaternionExport(plane);
    }
  }

  [XmlType(TypeName = "Quaternion")]
  public struct QuaternionExport
  {
    public float x, y, z, w;

    public QuaternionExport(Plane plane)
    {
      var q = Quaternion.Rotation(Plane.WorldXY, plane);

      w = (float) -q.A;
      x = (float) q.B;
      y = (float) q.D;
      z = (float) q.C;
    }
  }
# ---------- end c_script ----------
item = ListItem(List=panel_3, Index=number_slider, Wrap=False)
panel_9 = Panel(c_script)
panel_10 = Panel(item)
